# Grasshopper definition aula_1.gh (Grasshopper 0.9.76)

# https://www.youtube.com/watch?v=pFCrIzENDn8&list=PLapoQ_9M-ujfYGOsZProIXPGx-HRfjJ9C
# 
# parada 54:00
number_slider = Slider(1, range=0..1)
c_script = CSharpScript(x=number_slider, y=Slider(1, range=0..1), z=Slider(1, range=0..1))  # -> out, A, B; inputs x: Double, y: Double, z: Double
# ---------- c_script: C# ----------
    A = x + y;
    B = x + y + z;
# ---------- end c_script ----------
panel = Panel(c_script.A)
panel_2 = Panel(c_script.B)
